# Dynamo graph Convert Cad Block to Family.dyn "Convert Test" (Dynamo 2.19.3.6394)
# packages: Genius Loci 2024.5.29

code_block = CodeBlock { "Test"; }
select_model_element = DSModelElementSelection()  # 1 picked in the model
cad_block = Custom[CAD Block](importInstance=select_model_element)  # package Genius Loci; Get the location point, name and layer of the CAD blocks / XRefs from a CAD link or import. Please note : The non-uniform scaling of blocks is not supported (The X, Y and Z values ​​of the Block Scale must be the same).
byFamilyNameAndTypeName = FamilyType.ByFamilyNameAndTypeName(familyName=code_block, typeName=cad_block.BlockName)
levels = Levels("Level 1")
byPointAndLevel = FamilyInstance.ByPointAndLevel(familyType=byFamilyNameAndTypeName, point=cad_block.OriginPoint, level=levels)
code_block_2 = CodeBlock { -1; }
mul = cad_block.Rotation * code_block_2
setRotation = FamilyInstance.SetRotation(familyInstance=byPointAndLevel, degree=mul)
