# Dynamo graph LinkDWG.dyn (Dynamo 2.16.2.5624)
# packages: LinkDWG 0.3.91

boolean = BoolSelector(true)
select_model_element = DSModelElementSelection()  # 1 picked in the model
boolean_2 = BoolSelector(true)
getCOMObjects = Custom[ImportInstance.GetCOMObjects](LinkedDWG=select_model_element, VisibleAutoCAD=boolean_2)  # package LinkDWG; Get the particular COM objects (Text/MText/Attribute/Hatch) inside a linked DWG by opening and reading data via AutoCAD running in background
getCOMObjects_2 = Custom[ObjectDBX.GetCOMObjects](Run=boolean, COM_DBXDocument=getCOMObjects.0_COM_Document)  # package LinkDWG; Get all COM Objects from current DBX drawing
blockProperties = Custom[ActiveX.BlockProperties](COM_Block=getCOMObjects_2.13_COM_Blocks_MInserts)  # package LinkDWG; Get COM Block properties
contains = String.Contains(string=blockProperties.0_BlockName)  # unwired: searchFor
