# Dynamo graph Template_Delete_file Cad_import.dyn (Dynamo 2.16.2.5624)

element_classes = ElementTypes("ImportInstance")
all_elements_of_class = ElementsOfType(element_class=element_classes)
delete = Element.Delete(element=all_elements_of_class)
